# Requirement set Anforderungsspezifikation (R2025b)

## 1 [#1] Leichte Austauschbarkeit der Düse (Informational)
Düse kann kaputt gehen, muss regelmäßig ausgetauscht werden
Austausch ohne Schlung sollte möglich sein
Rationale: Kein aufwändiger Kundendienst notwendig, spart Geld
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
## 2 [#2] Kunststoff schmelzen

## 3 [#3] Sicherheitsanforderungen (Container)

### 3.1 [#4] Gehäuse (Informational)

### 3.2 [#5] Prozess nur aktiv, wenn Schutztür geschlossen