% Requirement links of Beispiel.slreqx (R2025b)

#1 relates to #3: Die Schraubfähigkeit eines Akkuschraubers, insbesondere seine Kraft (Drehmoment) und Geschwindigkeit (Drehzahl), hängt direkt von seiner Energieversorgung und Ausdauer (Akku) ab.  % 1. Energie bestimmt die Kraft (Drehmoment) 💪 Die Spannung (Volt, V) des Akkus ist entscheidend für die maximale Leistung des Motors und damit für das erzeugte Drehmoment. - Höhere Spannung (z.B. 18V statt 12V): Ermöglicht dem Motor, mehr Energie aufzunehmen und eine größere Kraft auf die Schraube zu übertragen. - Ergebnis: Ein Gerät mit höherer Spannung kann größere, längere oder dickere Schrauben in härtere Materialien eindrehen, da es das nötige hohe Drehmoment aufbringen kann. 2. Ausdauer bestimmt die Dauerleistung (Anzahl der Schrauben) 🔋 Die Akkukapazität (Amperestunden, Ah) bestimmt, wie lange der Schrauber diese Leistung bereitstellen kann. Sie ist direkt für die Ausdauer verantwortlich. - Höhere Kapazität (z.B. 4,0 Ah statt 2,0 Ah): Der Akku kann über einen längeren Zeitraum Energie liefern. - Ergebnis: Eine höhere Kapazität bedeutet, dass Sie deutlich mehr Schrauben pro Akkuladung eindrehen können, bevor das Gerät aufgeladen werden muss. Das ist essenziell für große Projekte oder den professionellen Dauereinsatz. 3. Effizienz und Laufzeit (Motor-Technologie) Die Kombination aus Motor und Akku beeinflusst die Gesamteffizienz: - Bürstenloser Motor (Brushless): Diese Motoren nutzen die zur Verfügung stehende Akkuenergie effizienter als herkömmliche Bürstenmotoren. - Folge: Bei gleicher Akkukapazität können mit einem bürstenlosen Schrauber mehr Schrauben verarbeitet werden, da weniger Energie als Wärme verloren geht. Kurz gesagt: Die Spannung ist das Maß für die maximale Kraft, während die Kapazität das Maß für die Ausdauer ist. Beides zusammen definiert, welche Schraubaufgaben Sie erfolgreich und wie lange Sie diese unterbrechungsfrei erledigen können.