% Simulink design studies Fault_Analyzer_Example.mldatx for model Fault_Analyzer_Example

study "DesignStudy": 3 simulations
  combinatorial set (3 points):
    "Fault Set_1": FaultSet(), values  (3 points)