test file "Simulink_Test_Example"
  coverage: Decision, MCDC, SignalRange, Condition, LookupTable, SignalSize

suite "Test Suite 1"

  suite "Test Suite 1.1"

    case "Testfall 1.1.1" [baseline]
      model Simulink_Test_Example, harness Simulink_Test_Example_SubsystemA_Harness1 (for Simulink_Test_Example/SubsystemA)
      logged signals "Signal Set 1": AOutBIn
      baseline "Signal_Editor_Block_Example.mat" (0 of 6 signals compared)
      custom criteria:
        signal = test.sltest_simout.get("logsout").get("AOutBIn").Values.Data(end);

        test.verifyEqual(signal, 0);
      assessment "Bounds-Check-Example": At any point of time, AOutBIn must be less than 1
      assessment "Trigger-Response-Example": At any point of time, whenever AOutBIn == 4 is true then, with a delay of at most 1, AOutBIn == 5 must stay true for at least 5
        AOutBIn: signal Simulink_Test_Example_SubsystemA_Harness1/SubsystemA, port 1

    case "Testfall 1.1.2" [simulation]

    case "Testfall 1.1.3" [simulation]

  suite "Test Suite 1.2"

    case "Testfall 1.2.1" [simulation]

    case "Testfall 1.2.2" [simulation]

    case "Testfall 1.2.3" [simulation]

suite "Test Suite 2"

  suite "Test Suite 2.1"

  suite "Test Suite 2.2"